# Grasshopper definition exportgeo.gh (Grasshopper 1.0.7)
# plug-ins: EleFront, gHowl

geo = Geometry(<brep referenced from the Rhino model>)
volume = Volume(Geometry=geo)  # -> Volume, Centroid
sec = BrepPlane(Brep=geo, Plane=volume.Centroid)  # -> Curves, Points
bbox = BoundingBox(Content=geo, Plane=PlaneXY(0, 0, 0))  # -> Box, Box_2
cp = ControlPoints(Curve=sec.Curves)  # -> Points, Weights, Knots
debox = DeconstructBox(Box=bbox.Box)  # -> Plane, X, Y, Z
project = Project(Geometry=cp.Points, Plane=PlaneXY(0, 0, 0))  # -> Geometry, Transform
area = Area(Geometry=sec.Curves)  # -> Area, Centroid
dedomain = DeconstructDomain(Domain=debox.Z)  # -> Start, End
pt = Point(Point(334882.3094, 6249523.529, 0))
panel = Panel("""min_height
height""")
expression = Expression(x=dedomain.Start, Expression="round(x, 1)")  # -> simplify(R)
expression_2 = Expression(x=dedomain.End, Expression="round(x, 1)")  # -> simplify(R)
xyz_geo = XYZToGeo(XYZ_IN=project.Geometry, EAP_XYZ=pt, EAP_Geo="151.2145836385542, -33.88172486727721, 0")
getuv = GetUserValue(Geometry=geo, Key="storeys")
multiplication = Multiplication(A=area.Area, B=graft(getuv))
multiplication_2 = Multiplication(A=multiplication, B=0.8)
pdecon = Deconstruct(Point=xyz_geo)  # -> XComponent, YComponent, ZComponent
sort = SortList(Keys=flatten(expression_2))  # -> reverse(Keys), ValuesA
round = Round(Number=multiplication_2)  # -> Nearest, Floor, Ceiling
panel_2 = Panel("area")
ma = MassAddition(Input=getuv)  # -> Result, PartialResults
panel_3 = Panel("storeys")
panel_4 = Panel("height")
ma_2 = MassAddition(Input=flatten(round.Nearest))  # -> Result, PartialResults
item = ListItem(List=sort.Keys, Index=0, Wrap=True)
trim = TrimTree(Tree=pdecon.YComponent, Depth=1)
trim_2 = TrimTree(Tree=pdecon.XComponent, Depth=1)
python = GhPythonScript(
    run=Toggle(False),
    area=ma_2.Result,
    storeys=ma.Result,
    min_height=expression,
    height=expression_2,
    tot_height=item,
    x=trim_2,
    y=trim,
    filename="\04_opt3b.geojson")  # -> out; inputs min_height: tree, height: tree, x: tree, y: tree
# ---------- python: Python ----------
__author__ = "JORDA"
__version__ = "2020.04.18"

import rhinoscriptsyntax as rs
import ghpythonlib.treehelpers as th
import json

area = area
storeys = storeys
min_height = th.tree_to_list(min_height)[0]
height = th.tree_to_list(height)[0]
tot_height = tot_height
x = th.tree_to_list(x)
y = th.tree_to_list(y)

features = []

if run == True:

    for i in range(len(min_height)):
        x_coords = x[i]
        y_coords = y[i]
        coords = []
        for z in range(len(x_coords)):
            coords.append([x_coords[z], y_coords[z]])
        feature = {
           "type": "Feature",
           "geometry": {
               "type": "Polygon",
               "coordinates": [coords]
               },
           "properties": {
               "area" : area,
               "storeys": storeys,
               "min_height": min_height[i],
               "height": height[i],
               "tot_height": tot_height
               }
            }
        features.append(feature)
    
    feature_collection = {
        "type": "FeatureCollection",
        "features": features
        }
    
    with open(r'C:\Users\JORDA\OneDrive\Desktop' + filename , 'w') as f:
        json.dump(feature_collection, f)

    print("Complete")
# ---------- end python ----------
panel_5 = Panel(python)
